% Simulink data dictionary AAA.sldd
% references Copy_of_AAA.sldd

FaultBus = Simulink.Bus(HeaderFile="fault_bus.h")  % 故障状态总线
  IcSensorFault: uint8, Unit="-"  % 电流传感器故障标志
  VoltageFault: boolean, Unit="-"  % 母线电压故障标志
  a: double

CtrlBus = Simulink.Bus(DataScope="Exported", HeaderFile="ctrl_bus.h")  % 控制总线
  Position: double, Unit="m"  % 位置矢量
  Velocity: double, Unit="m/s"  % 速度矢量

SignalA = myPackage.Signal(DoubleProperty=0, Int32Property=int32(0), LogicalProperty=false, OnOffCharProperty="off", ColorCharProperty="red", StorageClass="YS_SelectRAMSignal", HeaderFile="MCU_Fault_Signals.h", DefinitionFile="MCU_Fault_Signals.c", DataType="Bus: FaultBus", Unit="-")  % 故障状态信号总线
SignalB = myPackage.Signal(DoubleProperty=0, Int32Property=int32(0), LogicalProperty=false, OnOffCharProperty="off", ColorCharProperty="red", StorageClass="ExportedGlobal", DataType="single", Min=0, Max=100, Unit="m")  % 位置反馈信号
ParamA = myPackage.Parameter(111, DoubleProperty=0, Int32Property=int32(0), LogicalProperty=false, OnOffCharProperty="off", ColorCharProperty="red", StorageClass="YS_SelectRAMPara", HeaderFile="MCU_Fault_Paras.h", DefinitionFile="MCU_Fault_Paras.c", DataType="single", Min=0, Max=1000, Unit="A")  % A相电流故障限值设置
ParamB = myPackage.Parameter(0.35, DoubleProperty=0, Int32Property=int32(0), LogicalProperty=false, OnOffCharProperty="off", ColorCharProperty="red", StorageClass="ExportedGlobal", DataType="single", Min=0, Max=10, Unit="-")  % 速度环比例系数
ADD = Simulink.Parameter([])
Param = myPackage.Parameter([], DoubleProperty=0, Int32Property=int32(0), LogicalProperty=false, OnOffCharProperty="off", ColorCharProperty="red")